# Grasshopper definition A2.gh (Grasshopper 1.0.7)

slit_height_denominator = Slider(4, range=0..10)
rectangle_width = Slider(10, range=0..10)
rectangle_height = Slider(2, range=0..10)
slit_width = Slider(0.188, range=0..1)
integer = Integer(-2)
division = Division(A=rectangle_height, B=slit_height_denominator)
division_2 = Division(A=slit_width, B=integer)
integer_2 = Integer(3)
vector_xyz = VectorXYZ(XComponent=division_2, YComponent=0, ZComponent=0)  # -> Vector, Length
rectangle = Rectangle(Plane=PlaneXY(0, 0, 0), XSize=slit_width, YSize=division, Radius=0)  # -> Rectangle, Length
subtraction = Subtraction(A=rectangle_width, B=integer_2)
vector_xyz_2 = VectorXYZ(XComponent=subtraction, YComponent=0, ZComponent=0)  # -> Vector, Length
move = Move(Geometry=rectangle.Rectangle, Motion=vector_xyz.Vector)  # -> Geometry, Transform
integer_3 = Integer(2)
number = Number(0.01)
subtraction_2 = Subtraction(A=rectangle_height, B=division)
integer_4 = Integer(2)
number_2 = Number(-0.01)
linear_array = LinearArray(Geometry=move.Geometry, Direction=vector_xyz_2.Vector, Count=integer_3)  # -> Geometry, Transform
linear_array_2 = LinearArray(Geometry=move.Geometry, Direction=vector_xyz_2.Vector, Count=integer_3)  # -> Geometry, Transform
addition = Addition(A=subtraction_2, B=number)
integer_5 = Integer(1)
vector_xyz_3 = VectorXYZ(XComponent=integer_4, YComponent=number_2, ZComponent=0)  # -> Vector, Length
vector_xyz_4 = VectorXYZ(XComponent=integer_5, YComponent=addition, ZComponent=0)  # -> Vector, Length
move_2 = Move(Geometry=linear_array.Geometry, Motion=vector_xyz_3.Vector)  # -> Geometry, Transform
rectangle_2 = Rectangle(Plane=PlaneXY(0, 0, 0), XSize=rectangle_width, YSize=rectangle_height, Radius=0)  # -> Rectangle, Length
move_3 = Move(Geometry=linear_array_2.Geometry, Motion=vector_xyz_4.Vector)  # -> Geometry, Transform
trim_with_regions = TrimWithRegions(Curve=rectangle_2.Rectangle, Regions=move_2.Geometry)  # -> flatten(Inside), flatten(Outside)
trim_with_regions_2 = TrimWithRegions(Curve=move_2.Geometry, Regions=rectangle_2.Rectangle)  # -> flatten(Inside), flatten(Outside)
join_curves = JoinCurves(Curves=[trim_with_regions_2.Inside, trim_with_regions.Outside], Preserve=False)
trim_with_regions_3 = TrimWithRegions(Curve=move_3.Geometry, Regions=join_curves)  # -> flatten(Inside), Outside
trim_with_regions_4 = TrimWithRegions(Curve=join_curves, Regions=move_3.Geometry)  # -> Inside, flatten(Outside)
join_curves_2 = JoinCurves(Curves=[trim_with_regions_3.Inside, trim_with_regions_4.Outside], Preserve=False)
