# Grasshopper definition generate-model-v3.gh (Grasshopper 1.0.7)

# ---- group: Bottom Surface
# SLITS
# 
# // Set the slits to be equidistant within the height of the box (since the width is bigger to account for the thickness of each panel)
# ((boxHeight - (slithWidth * numberOfSlits)) / numberOfSlits) + slitWidth
# // Center the slidths within the box
# 
# // For the bottom slits
# (boxWidth - (((numberOfSlits - 1) * (slitDistance)) + slitWidth)) / 2
# 
# // For the side slits
# (boxHeight - (((numberOfSlits - 1) * (slitDistance)) + slitWidth)) / 2
# LEFT\RIGHT SLITS BEFORE ROTATION
slit_width = Slider(10.1, range=0..11)
notch_width = Slider(10, range=0..11)
slit_notch_depth = Slider(3, range=0..10)
number_slits_notches = Slider(2, range=0..10)
box_height = Slider(50, range=0..100)
multiplication = Multiplication(A=slit_notch_depth, B=number_slits_notches)
addition = Addition(A=multiplication, B=box_height)
slit = Rectangle(Plane=PlaneXY(0, 0, 0), XSize=slit_width, YSize=slit_notch_depth, Radius=0)  # -> Rectangle, Length
number_1 = Number(1)
integer_2 = Integer(2)
number_1_2 = Number(-0.1)
bounding_rectangle = Rectangle(Plane=PlaneXY(0, 0, 0), XSize=addition, YSize=box_height, Radius=0)  # -> Rectangle, Length
panel = Panel("RIGHT SLITS")

multiplication_2 = Multiplication(A=slit_width, B=number_slits_notches)
subtraction = Subtraction(A=box_height, B=multiplication_2)
division = Division(A=subtraction, B=number_slits_notches)
addition_2 = Addition(A=division, B=slit_width)
vector_xyz = VectorXYZ(XComponent=addition_2, YComponent=0, ZComponent=0)  # -> Vector, Length
slits = LinearArray(Geometry=slit.Rectangle, Direction=vector_xyz.Vector, Count=number_slits_notches)  # -> Geometry, Transform

subtraction_2 = Subtraction(A=number_slits_notches, B=number_1)
multiplication_3 = Multiplication(A=subtraction_2, B=addition_2)
addition_3 = Addition(A=multiplication_3, B=slit_width)
subtraction_3 = Subtraction(A=box_height, B=addition_3)
division_2 = Division(A=subtraction_3, B=integer_2)
vector_xyz_2 = VectorXYZ(XComponent=division_2, YComponent=0, ZComponent=0)  # -> Vector, Length
move = Move(Geometry=slits.Geometry, Motion=vector_xyz_2.Vector)  # -> Geometry, Transform

# ---- group: Bottom Surface / Bottom Slits
subtraction_4 = Subtraction(A=number_slits_notches, B=number_1)
multiplication_4 = Multiplication(A=subtraction_4, B=addition_2)
addition_4 = Addition(A=multiplication_4, B=slit_width)
subtraction_5 = Subtraction(A=addition, B=addition_4)
division_3 = Division(A=subtraction_5, B=integer_2)
vector_xyz_3 = VectorXYZ(XComponent=division_3, YComponent=number_1_2, ZComponent=0)  # -> Vector, Length
move_2 = Move(Geometry=slits.Geometry, Motion=vector_xyz_3.Vector)  # -> Geometry, Transform

# ---- group: Bottom Surface / Left Slits
integer_1 = Integer(-1)
multiplication_5 = Multiplication(A=slit_notch_depth, B=integer_1)
number_1_3 = Number(0.1)
addition_5 = Addition(A=multiplication_5, B=number_1_3)
vector_xyz_4 = VectorXYZ(XComponent=0, YComponent=addition_5, ZComponent=0)  # -> Vector, Length
move_3 = Move(Geometry=move.Geometry, Motion=vector_xyz_4.Vector)  # -> Geometry, Transform
rotate = Rotate(Geometry=move_3.Geometry, Angle=1.570796327, Plane=PlaneXY(0, 0, 0))  # -> Geometry, Transform

# ---- group: Bottom Surface / Top Slits
subtraction_6 = Subtraction(A=box_height, B=slit_notch_depth)
number_1_4 = Number(0.1)
addition_6 = Addition(A=number_1_4, B=subtraction_6)
vector_xyz_5 = VectorXYZ(XComponent=division_3, YComponent=addition_6, ZComponent=0)  # -> Vector, Length
move_4 = Move(Geometry=slits.Geometry, Motion=vector_xyz_5.Vector)  # -> Geometry, Transform

# ---- group: Bottom Surface / Right Slits
subtraction_7 = Subtraction(A=addition, B=slit_notch_depth)
number_2 = Number(0.2)
addition_7 = Addition(A=subtraction_7, B=number_2)
vector_xyz_6 = VectorXYZ(XComponent=addition_7, YComponent=0, ZComponent=0)  # -> Vector, Length
rotate_2 = Rotate(Geometry=move_3.Geometry, Angle=1.570796327, Plane=PlaneXY(0, 0, 0))  # -> Geometry, Transform
move_5 = Move(Geometry=rotate_2.Geometry, Motion=vector_xyz_6.Vector)  # -> Geometry, Transform

# ---- group: Bottom Surface / Create Single Curve
trim_with_regions = TrimWithRegions(Curve=move_2.Geometry, Regions=bounding_rectangle.Rectangle)  # -> flatten(Inside), Outside
trim_with_regions_2 = TrimWithRegions(Curve=bounding_rectangle.Rectangle, Regions=move_2.Geometry)  # -> Inside, flatten(Outside)
join_curves = JoinCurves(Curves=[trim_with_regions.Inside, trim_with_regions_2.Outside], Preserve=False)
trim_with_regions_3 = TrimWithRegions(Curve=join_curves, Regions=move_4.Geometry)  # -> Inside, flatten(Outside)
trim_with_regions_4 = TrimWithRegions(Curve=move_4.Geometry, Regions=join_curves)  # -> flatten(Inside), Outside
join_curves_2 = JoinCurves(Curves=[trim_with_regions_3.Outside, trim_with_regions_4.Inside], Preserve=False)
trim_with_regions_5 = TrimWithRegions(Curve=join_curves_2, Regions=rotate.Geometry)  # -> Inside, flatten(Outside)
trim_with_regions_6 = TrimWithRegions(Curve=rotate.Geometry, Regions=join_curves_2)  # -> flatten(Inside), Outside
join_curves_3 = JoinCurves(Curves=[trim_with_regions_5.Outside, trim_with_regions_6.Inside], Preserve=False)
trim_with_regions_7 = TrimWithRegions(Curve=move_5.Geometry, Regions=join_curves_3)  # -> flatten(Inside), Outside
trim_with_regions_8 = TrimWithRegions(Curve=join_curves_3, Regions=move_5.Geometry)  # -> Inside, flatten(Outside)
join_curves_4 = JoinCurves(Curves=[trim_with_regions_7.Inside, trim_with_regions_8.Outside], Preserve=False)

# ----
number = Number(55)
integer = Integer(65)
integer_3 = Integer(55)
integer_4 = Integer(55)
integer_5 = Integer(-60)
vector_xyz_7 = VectorXYZ(XComponent=0, YComponent=number, ZComponent=0)  # -> Vector, Length
vector_xyz_8 = VectorXYZ(XComponent=integer_5, YComponent=integer_4, ZComponent=0)  # -> Vector, Length
vector_xyz_9 = VectorXYZ(XComponent=integer, YComponent=integer_3, ZComponent=0)  # -> Vector, Length

# ---- group: Front/Back Surface
box_width_height = Slider(50, range=0..100)
number_slits_notches_2 = Slider(2, range=0..10)
notch_width_2 = Slider(10, range=0..11)
slit_notch_depth_2 = Slider(3, range=0..10)
bounding_rectangle_2 = Rectangle(Plane=PlaneXY(0, 0, 0), XSize=box_width_height, YSize=box_width_height, Radius=0)  # -> Rectangle, Length
notch = Rectangle(Plane=PlaneXY(0, 0, 0), XSize=notch_width_2, YSize=slit_notch_depth_2, Radius=0)  # -> Rectangle, Length

# // Set the slits to be equidistant within the box
# (boxWidth - (slithWidth * numberOfSlits)) + slitWidth
multiplication_6 = Multiplication(A=notch_width_2, B=number_slits_notches_2)
subtraction_8 = Subtraction(A=box_width_height, B=multiplication_6)
division_4 = Division(A=subtraction_8, B=number_slits_notches_2)
addition_8 = Addition(A=notch_width_2, B=division_4)
vector_xyz_10 = VectorXYZ(XComponent=addition_8, YComponent=0, ZComponent=0)  # -> Vector, Length

# ---- group: Front/Back Surface / Bottom Notches
# // Center the slidths within the box
# (boxWidth - (((numberOfSlits - 1) * (slitDistance)) + slitWidth)) / 2
integer_6 = Integer(1)
subtraction_9 = Subtraction(A=number_slits_notches_2, B=integer_6)
multiplication_7 = Multiplication(A=addition_8, B=subtraction_9)
number_3 = Number(-1)
addition_9 = Addition(A=notch_width_2, B=multiplication_7)
multiplication_8 = Multiplication(A=slit_notch_depth_2, B=number_3)
subtraction_10 = Subtraction(A=box_width_height, B=addition_9)
number_4 = Number(0.1)
integer_7 = Integer(2)
division_5 = Division(A=subtraction_10, B=integer_7)
addition_10 = Addition(A=multiplication_8, B=number_4)
vector_xyz_11 = VectorXYZ(XComponent=division_5, YComponent=addition_10, ZComponent=0)  # -> Vector, Length

# ---- group: Front/Back Surface (continued)
notches = LinearArray(Geometry=notch.Rectangle, Direction=vector_xyz_10.Vector, Count=number_slits_notches_2)  # -> Geometry, Transform

# ---- group: Front/Back Surface / Left Notches
number_5 = Number(-0.1)
vector_xyz_12 = VectorXYZ(XComponent=division_5, YComponent=number_5, ZComponent=0)  # -> Vector, Length
move_6 = Move(Geometry=notches.Geometry, Motion=vector_xyz_12.Vector)  # -> Geometry, Transform
rotate_3 = Rotate(Geometry=move_6.Geometry, Angle=1.570796327, Plane=PlaneXY(0, 0, 0))  # -> Geometry, Transform

# ---- group: Front/Back Surface / Right Notches
addition_11 = Addition(A=box_width_height, B=slit_notch_depth_2)
number_6 = Number(-0.2)
addition_12 = Addition(A=addition_11, B=number_6)
vector_xyz_13 = VectorXYZ(XComponent=addition_12, YComponent=0, ZComponent=0)  # -> Vector, Length
rotate_4 = Rotate(Geometry=move_6.Geometry, Angle=1.570796327, Plane=PlaneXY(0, 0, 0))  # -> Geometry, Transform
move_7 = Move(Geometry=rotate_4.Geometry, Motion=vector_xyz_13.Vector)  # -> Geometry, Transform

# ---- group: Front/Back Surface / Bottom Notches
move_8 = Move(Geometry=notches.Geometry, Motion=vector_xyz_11.Vector)  # -> Geometry, Transform

# ---- group: Front/Back Surface / Create Single Curve
trim_with_regions_9 = TrimWithRegions(Curve=move_8.Geometry, Regions=bounding_rectangle_2.Rectangle)  # -> Inside, flatten(Outside)
trim_with_regions_10 = TrimWithRegions(Curve=bounding_rectangle_2.Rectangle, Regions=move_8.Geometry)  # -> Inside, flatten(Outside)
join_curves_5 = JoinCurves(Curves=[trim_with_regions_10.Outside, trim_with_regions_9.Outside], Preserve=False)
trim_with_regions_11 = TrimWithRegions(Curve=join_curves_5, Regions=rotate_3.Geometry)  # -> Inside, flatten(Outside)
trim_with_regions_12 = TrimWithRegions(Curve=rotate_3.Geometry, Regions=join_curves_5)  # -> Inside, flatten(Outside)
join_curves_6 = JoinCurves(Curves=[trim_with_regions_11.Outside, trim_with_regions_12.Outside], Preserve=False)
trim_with_regions_13 = TrimWithRegions(Curve=join_curves_6, Regions=move_7.Geometry)  # -> Inside, flatten(Outside)
trim_with_regions_14 = TrimWithRegions(Curve=move_7.Geometry, Regions=join_curves_6)  # -> Inside, flatten(Outside)
join_curves_7 = JoinCurves(Curves=[trim_with_regions_13.Outside, trim_with_regions_14.Outside], Preserve=False)

# ---- group: Left/Right Surface
# // Set the slits to be equidistant within the box
# (boxWidth - (slithWidth * numberOfSlits)) + slitWidth
box_width_height_2 = Slider(50, range=0..100)
slit_width_2 = Slider(10.1, range=0..11)
slit_notch_depth_3 = Slider(3, range=0..10)
number_slits_notches_3 = Slider(2, range=0..10)
notch_width_3 = Slider(10, range=0..11)
bounding_rectangle_3 = Rectangle(Plane=PlaneXY(0, 0, 0), XSize=box_width_height_2, YSize=box_width_height_2, Radius=0)  # -> Rectangle, Length
slit_2 = Rectangle(Plane=PlaneXY(0, 0, 0), XSize=slit_width_2, YSize=slit_notch_depth_3, Radius=0)  # -> Rectangle, Length
notch_2 = Rectangle(Plane=PlaneXY(0, 0, 0), XSize=notch_width_3, YSize=slit_notch_depth_3, Radius=0)  # -> Rectangle, Length

multiplication_9 = Multiplication(A=notch_width_3, B=number_slits_notches_3)
subtraction_11 = Subtraction(A=box_width_height_2, B=multiplication_9)
division_6 = Division(A=subtraction_11, B=number_slits_notches_3)
addition_13 = Addition(A=notch_width_3, B=division_6)
vector_xyz_14 = VectorXYZ(XComponent=addition_13, YComponent=0, ZComponent=0)  # -> Vector, Length

notches_2 = LinearArray(Geometry=notch_2.Rectangle, Direction=vector_xyz_14.Vector, Count=number_slits_notches_3)  # -> Geometry, Transform
slits_2 = LinearArray(Geometry=slit_2.Rectangle, Direction=vector_xyz_14.Vector, Count=number_slits_notches_3)  # -> Geometry, Transform

# ---- group: Left/Right Surface / Bottom Notches
# // Center the slits within the box
# (boxWidth - (((numberOfSlits - 1) * (slitDistance)) + slitWidth)) / 2
integer_8 = Integer(1)
subtraction_12 = Subtraction(A=number_slits_notches_3, B=integer_8)
multiplication_10 = Multiplication(A=addition_13, B=subtraction_12)
number_7 = Number(-1)
addition_14 = Addition(A=notch_width_3, B=multiplication_10)
multiplication_11 = Multiplication(A=slit_notch_depth_3, B=number_7)
subtraction_13 = Subtraction(A=box_width_height_2, B=addition_14)
number_8 = Number(0.1)
integer_9 = Integer(2)
division_7 = Division(A=subtraction_13, B=integer_9)
addition_15 = Addition(A=multiplication_11, B=number_8)
vector_xyz_15 = VectorXYZ(XComponent=division_7, YComponent=addition_15, ZComponent=0)  # -> Vector, Length
move_9 = Move(Geometry=notches_2.Geometry, Motion=vector_xyz_15.Vector)  # -> Geometry, Transform

# ---- group: Left/Right Surface / Left Slits
integer_10 = Integer(-1)
multiplication_12 = Multiplication(A=slit_notch_depth_3, B=integer_10)
number_9 = Number(0.1)
addition_16 = Addition(A=multiplication_12, B=number_9)
vector_xyz_16 = VectorXYZ(XComponent=division_7, YComponent=addition_16, ZComponent=0)  # -> Vector, Length
move_10 = Move(Geometry=slits_2.Geometry, Motion=vector_xyz_16.Vector)  # -> Geometry, Transform
rotate_5 = Rotate(Geometry=move_10.Geometry, Angle=1.570796327, Plane=PlaneXY(0, 0, 0))  # -> Geometry, Transform

# ---- group: Left/Right Surface / Right Slits
subtraction_14 = Subtraction(A=box_width_height_2, B=slit_notch_depth_3)
number_10 = Number(0.2)
addition_17 = Addition(A=subtraction_14, B=number_10)
vector_xyz_17 = VectorXYZ(XComponent=addition_17, YComponent=0, ZComponent=0)  # -> Vector, Length
rotate_6 = Rotate(Geometry=move_10.Geometry, Angle=1.570796327, Plane=PlaneXY(0, 0, 0))  # -> Geometry, Transform
move_11 = Move(Geometry=rotate_6.Geometry, Motion=vector_xyz_17.Vector)  # -> Geometry, Transform

# ---- group: Left/Right Surface / Create Single Curve
trim_with_regions_15 = TrimWithRegions(Curve=bounding_rectangle_3.Rectangle, Regions=move_9.Geometry)  # -> Inside, flatten(Outside)
trim_with_regions_16 = TrimWithRegions(Curve=move_9.Geometry, Regions=bounding_rectangle_3.Rectangle)  # -> Inside, flatten(Outside)
join_curves_8 = JoinCurves(Curves=[trim_with_regions_16.Outside, trim_with_regions_15.Outside], Preserve=False)  # -> flatten(Curves)
trim_with_regions_17 = TrimWithRegions(Curve=rotate_5.Geometry, Regions=join_curves_8)  # -> flatten(Inside), Outside
trim_with_regions_18 = TrimWithRegions(Curve=join_curves_8, Regions=rotate_5.Geometry)  # -> Inside, flatten(Outside)
join_curves_9 = JoinCurves(Curves=[trim_with_regions_18.Outside, trim_with_regions_17.Inside], Preserve=False)
trim_with_regions_19 = TrimWithRegions(Curve=join_curves_9, Regions=move_11.Geometry)  # -> Inside, flatten(Outside)
trim_with_regions_20 = TrimWithRegions(Curve=move_11.Geometry, Regions=join_curves_9)  # -> flatten(Inside), Outside
join_curves_10 = JoinCurves(Curves=[trim_with_regions_19.Outside, trim_with_regions_20.Inside], Preserve=False)

# ---- group: BAKE US
move_12 = Move(Geometry=join_curves_4, Motion=vector_xyz_7.Vector)  # -> Geometry, Transform
move_13 = Move(Geometry=join_curves_10, Motion=vector_xyz_8.Vector)  # -> Geometry, Transform
move_14 = Move(Geometry=join_curves_7, Motion=vector_xyz_9.Vector)  # -> Geometry, Transform
