# Grasshopper definition AnchorBase.gh (Grasshopper 1.0.7)

# ANCHOR BASE - OUTER RADIUS
number_slider = Slider(25, range=0..25)
number_slider_2 = Slider(2, range=0..25)
panel = Panel("ANCHOR BASE - HEIGHT")
# ANCHOR BASE - CROSS SECTION WIDTH
number_slider_3 = Slider(5, range=0..25)

_2 = Number(2)
multiplication = Multiplication(A=number_slider, B=_2)
panel_2 = Panel("(OuterRadius * 2) - 2)")
_2_2 = Number(2)
subtraction = Subtraction(A=multiplication, B=_2_2)

# ---- group: Anchor Base Inner Cylinder
# [anchor base outer radius - cross section width)
subtraction_2 = Subtraction(A=number_slider, B=number_slider_3)
cylinder = Cylinder(Base=PlaneXY(0, 0, 0), Radius=subtraction_2, Length=number_slider_2)
cap_holes = CapHoles(Brep=cylinder)

# ---- group: Anchor Base Outer Cylinder
cylinder_2 = Cylinder(Base=PlaneXY(0, 0, 0), Radius=number_slider, Length=number_slider_2)
cap_holes_2 = CapHoles(Brep=cylinder_2)

# ----
rectangle = Rectangle(Plane=PlaneXY(0, 0, 0), XSize=number_slider_3, YSize=subtraction, Radius=0)  # -> Rectangle, Length
# CROSS SECTION PIECE #1
box_rectangle = BoxRectangle(Rectangle=rectangle.Rectangle, Height=number_slider_2)

# ---- group: Center the Cross Section Piece
_1 = Number(1)
subtraction_3 = Subtraction(A=number_slider, B=_1)
_2_3 = Number(2)
division = Division(A=number_slider_3, B=_2_3)
negative = Negative(Value=division)
negative_2 = Negative(Value=subtraction_3)
vector_xyz = VectorXYZ(XComponent=negative, YComponent=negative_2, ZComponent=0)  # -> Vector, Length
move = Move(Geometry=box_rectangle, Motion=vector_xyz.Vector)  # -> Geometry, Transform

# ----
solid_difference = SolidDifference(BrepsA=cap_holes_2, BrepsB=cap_holes)

# ---- group: Duplicate the Cross Section and Rotate It
# CROSS SECTION PIECE #2
move_2 = Move(Geometry=box_rectangle, Motion=vector_xyz.Vector)  # -> Geometry, Transform
rotate = Rotate(Geometry=move_2.Geometry, Angle=1.570796327, Plane=PlaneXY(0, 0, 0))  # -> Geometry, Transform

# ----
# Union the anchor and cross sections
solid_union = SolidUnion(Breps=[solid_difference, move.Geometry, rotate.Geometry])
