# Grasshopper definition PlantClips.gh (Grasshopper 1.0.7)

leg_width = Slider(6, range=1..100)
leg_height = Slider(37, range=0..100)
leg_gap = Slider(43, range=0..100)

# ---- group: Array for Printing
# BAKE THE JOINED CURVE FROM THE SCRIPT ABOVE AND REMOVE INSIDE EDGES IN RHINO. SELECT THE RESULTING CURVE AS THE INPUT CURVE FOR THIS COMPONENT.
curve = Curve()

# ---- group: Leg / Position the point on the leg
expression = Expression(x=leg_width, Expression="x*(3^(1/2))/3")
_3 = Number(3)
polygon = Polygon(Plane=PlaneXY(0, 0, 0), Radius=expression, Segments=_3, FilletRadius=0)  # -> Polygon, Length
number = Number(30)
division = Division(A=leg_width, B=2)
rotate = Rotate(Geometry=polygon.Polygon, Angle=degrees(number), Plane=PlaneXY(0, 0, 0))  # -> Geometry, Transform
division_2 = Division(A=expression, B=2)
negative = Negative(Value=division_2)
vector_xyz = VectorXYZ(XComponent=division, YComponent=negative, ZComponent=0)  # -> Vector, Length
move = Move(Geometry=rotate.Geometry, Motion=vector_xyz.Vector)  # -> Geometry, Transform

# ---- group: Leg
rectangle = Rectangle(Plane=PlaneXY(0, 0, 0), XSize=leg_width, YSize=leg_height, Radius=0)  # -> Rectangle, Length
join_curves = JoinCurves(Curves=[move.Geometry, rectangle.Rectangle], Preserve=False)

# ---- group: Outer Circle
addition = Addition(A=leg_width, B=leg_gap)
division_3 = Division(A=addition, B=2)
vector_xyz_2 = VectorXYZ(XComponent=division_3, YComponent=leg_height, ZComponent=0)  # -> Vector, Length
circle = Circle(Plane=PlaneXY(0, 0, 0), Radius=division_3)
move_2 = Move(Geometry=circle, Motion=vector_xyz_2.Vector)  # -> Geometry, Transform

# ---- group: Array for Printing
number_2 = Number(180)
rotate_2 = Rotate(Geometry=curve, Angle=degrees(number_2), Plane=PlaneXY(0, 0, 0))  # -> Geometry, Transform
division_4 = Division(A=leg_width, B=2)
addition_2 = Addition(A=division_3, B=division_4)
addition_3 = Addition(A=leg_gap, B=addition_2)
vector_xyz_3 = VectorXYZ(XComponent=addition_3, YComponent=leg_height, ZComponent=0)  # -> Vector, Length
multiplication = Multiplication(A=division_3, B=2)
multiplication_2 = Multiplication(A=addition, B=1.5)
move_3 = Move(Geometry=rotate_2.Geometry, Motion=vector_xyz_3.Vector)  # -> Geometry, Transform
addition_4 = Addition(A=leg_height, B=multiplication)
rectangle_2 = Rectangle(Plane=PlaneXY(0, 0, 0), XSize=multiplication_2, YSize=addition_4, Radius=0)  # -> Rectangle, Length
rectangular_array = RectangularArray(
    Geometry=[curve, move_3.Geometry],
    Cell=rectangle_2.Rectangle,
    XCount=Slider(4, range=0..100),
    YCount=Slider(4, range=0..100))  # -> Geometry, Transform

# ---- group: Inner Circle
negative_2 = Negative(Value=leg_width)
offset_curve = OffsetCurve(Curve=move_2.Geometry, Distance=negative_2, Corners=1)

# ----
rectangle_3 = Rectangle(Plane=PlaneXY(0, 0, 0), XSize=addition, YSize=leg_height, Radius=0)  # -> Rectangle, Length
trim_with_region = TrimWithRegion(Curve=offset_curve, Region=rectangle_3.Rectangle)  # -> Inside, Outside
trim_with_region_2 = TrimWithRegion(Curve=move_2.Geometry, Region=rectangle_3.Rectangle)  # -> Inside, Outside
join_curves_2 = JoinCurves(Curves=[move.Geometry, rectangle.Rectangle], Preserve=False)
unit_x = UnitX(Factor=leg_gap)
move_4 = Move(Geometry=join_curves_2, Motion=unit_x)  # -> Geometry, Transform
join_curves_3 = JoinCurves(Curves=[move_4.Geometry, trim_with_region_2.Outside, trim_with_region.Outside, join_curves], Preserve=False)  # -> flatten(Curves)
